# Grasshopper definition grasshopper data representation.gh (Grasshopper 1.0.7)

python = GhPythonScript()  # -> out, pts, ls, ss
# ---------- python: Python ----------
import Rhino.Geometry as rg

tuple_list = [(73.98513773237664, 217.42822262341846, 513.3030937437644, 255.93705345075682, 3), (44.30186591931779, 67.3149413627495, 211.04349654805577, 79.13933255000576, 3), (143.75115355691344, 1009.982177734375, 884.8862196626673, 1023.1380826163315, 3), (75.41820909106531, 162.98046874845116,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

ls = []
ss = []
pts = []

for l, a, a_f, a_r, s in tuple_list:
    
    try:
        pts.append(rg.Point3d(a, l * 10., s * 10.0) )
        ls.append(l)
        ss.append(a_f)
    except:
        pass
# ---------- end python ----------
bnd = Bounds(Numbers=python.ss)
bnd_2 = Bounds(Numbers=python.ls)
python_2 = GhPythonScript()  # -> out, v_list
# ---------- python_2: Python ----------
v_list = [[[769, 79.511959270184], [769, 79.28686946128316]], [[769, 80.28686946128316], [769, 80.10655187586673]], [[769, 80.97008694845346], [769.7791871614327, 81]], [[769, 87.99805661961643], [769.0147690101174, 88]], [[769, 89.12833312002465], [769, 89.28936921188239]], [[769,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
# ---------- end python_2 ----------
remap = RemapNumbers(Value=python.ls, Source=bnd_2, Target=Domain(0, 1))  # -> Mapped, Clipped
remap_2 = RemapNumbers(Value=python.ss, Source=bnd, Target=Domain(0, 1))  # -> Mapped, Clipped
pt = Point(python.pts)
hsv = ColourHSV(Alpha=1, Hue=remap_2.Mapped, Saturation=1, Value=1)
python_3 = GhPythonScript(x=python_2.v_list)  # -> out, lns; inputs x: list
# ---------- python_3: Python ----------
import Rhino.Geometry as rg

lns = []

for pair in x:
    lns.append(rg.Line(
        rg.Point3d(pair[0][0], pair[0][1], 0.),
        rg.Point3d(pair[1][0], pair[1][1], 0.)
    ))
# ---------- end python_3 ----------
dots = DotDisplay(Point=pt, Colour=hsv, Size=Slider(25, range=0..1000))
panel = Panel(python_3.out)
